# Grasshopper definition Estrutura Waffle.gh (Grasshopper 1.0.7)

number_slider = Slider(0.5, range=0.1..0.8)
surface = Surface(<surface referenced from the Rhino model>)
divide_surface = DivideSurface(Surface=surface, UCount=Slider(12, range=1..15), VCount=Slider(7, range=1..15))  # -> Points, Normals, Parameters

# ---- group: Novos componentes
divide_surface_2 = DivideSurface(UCount=10, VCount=10)  # -> Points, Normals, Parameters
extrude = Extrude()

# ----
flip_matrix = FlipMatrix(Data=divide_surface.Points)
interpolate = Interpolate(Vertices=divide_surface.Points, Degree=3, Periodic=False, KnotStyle=1)  # -> Curve, Length, Domain
interpolate_2 = Interpolate(Vertices=flip_matrix, Degree=3, Periodic=False, KnotStyle=1)  # -> Curve, Length, Domain

unit_z = UnitZ(Factor=Slider(2, range=0.1..2))
extrude_2 = Extrude(Base=interpolate.Curve, Direction=unit_z)
extrude_3 = Extrude(Base=interpolate_2.Curve, Direction=unit_z)

unit_y = UnitY(Factor=number_slider)
unit_x = UnitX(Factor=number_slider)
extrude_4 = Extrude(Base=extrude_2, Direction=unit_y)
extrude_5 = Extrude(Base=extrude_3, Direction=unit_x)

image_gallery = ImageGallery(CycleDelay=30, Randomize=False, UseLocalImages=True, UseRemoteImages=True)
