# Grasshopper definition (wip)Estrutura Waffle.gh (Grasshopper 1.0.7)

number_slider = Slider(0.1, range=0.1..0.5)
surface = Surface(<surface referenced from the Rhino model>)
divide_surface = DivideSurface(Surface=surface, UCount=Slider(10, range=1..10), VCount=Slider(10, range=1..10))  # -> Points, Normals, Parameters
flip_matrix = FlipMatrix(Data=divide_surface.Points)
interpolate = Interpolate(Vertices=divide_surface.Points, Degree=3, Periodic=False, KnotStyle=1)  # -> Curve, Length, Domain
interpolate_2 = Interpolate(Vertices=flip_matrix, Degree=3, Periodic=False, KnotStyle=1)  # -> Curve, Length, Domain
average = Average(Input=divide_surface.Normals)
extrude = Extrude(Base=interpolate.Curve, Direction=average)
extrude_2 = Extrude(Base=interpolate_2.Curve, Direction=average)
